# Grasshopper definition scpt2.gh (Grasshopper 0.9.76)
# plug-ins: Python Interpreter, Human

# ---- group: get inputs from job results
python = PythonScript(jobName="_job name_", id="0")  # -> out, inputs
# ---------- python: Python ----------
path = ghenv.Component.OnPingDocument().FilePath
path = path.split("\\")
path = "\\".join(path[:-1] + [jobName, "results.tsv"])

with open(path, 'r') as f:
    data = f.readlines()

headers = data.pop(0).split('\t')

designs = {}
for d in data:
    line = d.split('\t')
    designs[ int(line[headers.index('id')]) ] = [x for i,x in enumerate(line) if "[in" in headers[i] or "[ser" in headers[i]]

inputs = designs[int(id)]
# ---------- end python ----------

# ---- group: get inputs from file
python_2 = PythonScript()  # -> out, path
# ---------- python_2: Python ----------
path = ghenv.Component.OnPingDocument().FilePath
path = path.split("\\")
path = "\\".join(path[:-1] + ["inputs.txt"])
# ---------- end python_2 ----------
file = ReadFile(File=python_2.path, PerLineParse=True)

# ----
number_slider = Slider(50, range=0..100)
data_in = Panel(file)
bang = ExplodeTree(Inputs=simplify(graft(file)))  # -> Branch0, Branch1, Branch2, Branch3, Branch4, Branch5, Branch6, Branch7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
crv = Curve(<curve referenced from the Rhino model>)
sqgrid = Square(Plane=PlaneXY(0, 0, 0), Size=1, ExtentX=number_slider, ExtentY=number_slider)  # -> Cells, Points

# ---- group: unpack series
python_3 = PythonScript()  # -> out, a
# ---------- python_3: Python ----------
import json

a = json.loads(x)
# ---------- end python_3 ----------

# ----
incurve = PointInCurve(Point=sqgrid.Points, Curve=flatten(crv))  # -> flatten(Relationship), Point
crv_2 = Curve(<curve referenced from the Rhino model>)
dispatch = Dispatch(List=flatten(sqgrid.Points), DispatchPattern=incurve.Relationship)  # -> ListA, ListB
pt = Point(dispatch.ListA)

number_slider_2 = Slider(479, range=0..600)
item = ListItem(List=flatten(pt), Index=bang.Branch0, Wrap=True)
rectangle = Rectangle(Plane=item, XSize=Domain(0, 1), YSize=Domain(-25, 25), Radius=0)  # -> Rectangle, Length
crv_3 = Curve(rectangle.Rectangle)
incurve_2 = PointInCurve(Point=pt, Curve=flatten(crv_3))  # -> flatten(Relationship), Point
dispatch_2 = Dispatch(List=flatten(pt), DispatchPattern=incurve_2.Relationship)  # -> ListA, ListB
pt_2 = Point(dispatch_2.ListB)

number_slider_3 = Slider(112, range=0..665)
item_2 = ListItem(List=flatten(pt_2), Index=bang.Branch1, Wrap=True)
rectangle_2 = Rectangle(Plane=item_2, XSize=Domain(-50, 50), YSize=Domain(0, 1), Radius=0)  # -> Rectangle, Length
crv_4 = Curve(rectangle_2.Rectangle)
incurve_3 = PointInCurve(Point=pt_2, Curve=flatten(crv_4))  # -> flatten(Relationship), Point
dispatch_3 = Dispatch(List=flatten(pt_2), DispatchPattern=incurve_3.Relationship)  # -> ListA, ListB
pt_3 = Point(dispatch_3.ListB)

number_slider_4 = Slider(171, range=0..665)
item_3 = ListItem(List=flatten(pt_3), Index=bang.Branch2, Wrap=True)
rectangle_3 = Rectangle(Plane=item_3, XSize=Domain(0, 1), YSize=Domain(-20, 20), Radius=0)  # -> Rectangle, Length
crv_5 = Curve(rectangle_3.Rectangle)
incurve_4 = PointInCurve(Point=pt_3, Curve=flatten(crv_5))  # -> flatten(Relationship), Point
dispatch_4 = Dispatch(List=flatten(pt_3), DispatchPattern=incurve_4.Relationship)  # -> ListA, ListB
pt_4 = Point(dispatch_4.ListB)

number_slider_5 = Slider(34, range=0..664)
item_4 = ListItem(List=flatten(pt_4), Index=bang.Branch3, Wrap=True)
rectangle_4 = Rectangle(Plane=item_4, XSize=Domain(-50, 50), YSize=Domain(0, 1), Radius=0)  # -> Rectangle, Length
crv_6 = Curve(rectangle_4.Rectangle)
incurve_5 = PointInCurve(Point=pt_4, Curve=flatten(crv_6))  # -> flatten(Relationship), Point
dispatch_5 = Dispatch(List=flatten(pt_4), DispatchPattern=incurve_5.Relationship)  # -> ListA, ListB
pt_5 = Point(dispatch_5.ListB)

pt_6 = Point(dispatch_4.ListA)
pt_7 = Point(dispatch_5.ListA)
pt_8 = Point(dispatch_3.ListA)
pt_9 = Point(dispatch_2.ListA)
crv_7 = Curve([crv_4, crv_3, crv_5, crv_6])
runion = RegionUnion(Curves=flatten(crv_7))  # -> flatten(Result)
number_slider_6 = Slider(12, range=0..30)
number_slider_7 = Slider(20, range=0..30)
number_slider_8 = Slider(28, range=0..50)
number_slider_9 = Slider(35, range=0..50)
range = Range(Domain=Domain(-6, 6), Steps=12)
range_2 = Range(Domain=Domain(-6, 6), Steps=12)
range_3 = Range(Domain=Domain(-6, 6), Steps=12)
range_4 = Range(Domain=Domain(-6, 6), Steps=12)
item_5 = ListItem(List=flatten(pt_8), Index=bang.Branch5, Wrap=True)
item_6 = ListItem(List=flatten(pt_9), Index=bang.Branch4, Wrap=True)
item_7 = ListItem(List=flatten(pt_6), Index=bang.Branch6, Wrap=True)
item_8 = ListItem(List=flatten(pt_7), Index=bang.Branch7, Wrap=True)
item_9 = ListItem(List=range, Index=bang.Branch11, Wrap=True)
item_10 = ListItem(List=range, Index=bang.Branch10, Wrap=True)
item_11 = ListItem(List=range_2, Index=bang.Branch15, Wrap=True)
item_12 = ListItem(List=range_2, Index=bang.Branch14, Wrap=True)
item_13 = ListItem(List=range_3, Index=bang.Branch9, Wrap=True)
item_14 = ListItem(List=range_3, Index=bang.Branch8, Wrap=True)
item_15 = ListItem(List=range_4, Index=bang.Branch13, Wrap=True)
item_16 = ListItem(List=range_4, Index=bang.Branch12, Wrap=True)
rectangle_5 = Rectangle(Plane=item_5, XSize=item_10, YSize=item_9, Radius=0)  # -> Rectangle, Length
rectangle_6 = Rectangle(Plane=item_6, XSize=item_14, YSize=item_13, Radius=0)  # -> Rectangle, Length
rectangle_7 = Rectangle(Plane=item_7, XSize=item_16, YSize=item_15, Radius=0)  # -> Rectangle, Length
rectangle_8 = Rectangle(Plane=item_8, XSize=item_12, YSize=item_11, Radius=0)  # -> Rectangle, Length
crv_8 = Curve(rectangle_5.Rectangle)
crv_9 = Curve(rectangle_6.Rectangle)
crv_10 = Curve(rectangle_7.Rectangle)
crv_11 = Curve(rectangle_8.Rectangle)
crv_12 = Curve([crv_9, crv_8, crv_10, crv_11])
runion_2 = RegionUnion(Curves=crv_12)
crv_13 = Curve(crv)
crv_14 = Curve(runion)
area = Area(Geometry=runion_2)  # -> Area, Centroid
area_2 = Area(Geometry=crv_14)  # -> Area, Centroid
ma = MassAddition(Input=area.Area)  # -> Result, PartialResults
rint = RegionIntersection(CurvesA=crv_14, CurvesB=crv_13)
rint_2 = RegionIntersection(CurvesA=runion_2, CurvesB=crv_13)
panel = Panel(ma.Result)
area_3 = Area(Geometry=rint_2)  # -> Area, Centroid
area_4 = Area(Geometry=rint)  # -> Area, Centroid
sort = SortList(Keys=area_4.Area)  # -> Keys, ValuesA
mindex = MemberIndex(Set=area_4.Area, Member=sort.Keys)  # -> flatten(Index), Count
item_17 = ListItem(List=rint, Index=mindex.Index, Wrap=True)
panel_2 = Panel(area_3.Area)
panel_3 = Panel(area_4.Area)
area_5 = Area(Geometry=item_17)  # -> Area, Centroid
panel_4 = Panel(area_5.Area)
intersection_curve = ItemSelector(item_17, {"Polyline Curve", "Polyline Curve"}, selected="Polyline Curve")
road_curve = ItemSelector(item_17, {"Polyline Curve", "Polyline Curve"}, selected="Polyline Curve")
bang_2 = ExplodeTree(Data=graft(item_17))  # -> Branch0, Branch1
rdiff = RegionDifference(CurvesA=rint_2, CurvesB=bang_2.Branch1)
boundary = BoundarySurfaces(Edges=bang_2.Branch0)
boundary_2 = BoundarySurfaces(Edges=bang_2.Branch1)
rdiff_2 = RegionDifference(CurvesA=boundary_2, CurvesB=boundary)
area_6 = Area(Geometry=crv_12)  # -> Area, Centroid
crv_15 = Curve(flatten(rdiff))
area_7 = Area(Geometry=bang_2.Branch0)  # -> Area, Centroid
boundary_3 = BoundarySurfaces(Edges=rdiff)
area_8 = Area(Geometry=bang_2.Branch1)  # -> Area, Centroid
boundary_4 = BoundarySurfaces(Edges=rdiff_2)
area_9 = Area(Geometry=crv_15)  # -> flatten(Area), Centroid
bang_3 = ExplodeTree(Data=graft(area_6.Centroid))  # -> Branch0, Branch1, Branch2, Branch3, Branch4, Branch5
colour = ColourPicker(PickedColour=RGBA(0, 0, 0, 132))
subtraction = Subtraction(A=area_8.Area, B=area_7.Area)
colour_2 = ColourPicker(PickedColour=RGB(163, 255, 0))
srf4pt = _4PointSurface(CornerA=bang_3.Branch0, CornerB=bang_3.Branch1, CornerC=bang_3.Branch2, CornerD=bang_3.Branch3)
ma_2 = MassAddition(Input=area_9.Area)  # -> Result, PartialResults
preview = CustomPreview(Geometry=boundary_4, Shader=colour)
area_10 = Area(Geometry=srf4pt)  # -> flatten(Area), Centroid
park_area = Panel(ma_2.Result)
preview_2 = CustomPreview(Geometry=boundary_3, Shader=colour_2)
intersection_area = Panel(area_7.Area)
road_area = Panel(subtraction)
parrk_centers = Panel(area_10.Area)
multiplication = Multiplication(A=park_area, B=10)
ma_3 = MassAddition(Input=flatten([multiplication, parrk_centers, road_area, intersection_area]))  # -> Result, PartialResults
fitness_max = Panel(ma_3.Result)
merge = Merge(Data1=flatten(park_area), Data2=flatten(parrk_centers), Data3=flatten(road_area), Data4=flatten(intersection_area))
data_out = Panel(merge)

# ---- group: write to output file
python_4 = PythonScript(data=merge)  # -> out; inputs data: list
# ---------- python_4: Python ----------
import pickle
import rhinoscriptsyntax as rs

localFolder = "\\".join(ghenv.Component.OnPingDocument().FilePath.split("\\")[:-1]) + "\\"

outputFile = localFolder + "outputs.txt"
with open(outputFile, 'w') as f:
    f.write('\n'.join([str(x) for x in data]))

print "complete"
# ---------- end python_4 ----------

# ---- group: screenshot
python_5 = PythonScript()  # -> out, path
# ---------- python_5: Python ----------
path = ghenv.Component.OnPingDocument().FilePath
path = path.split("\\")
path = "\\".join(path[:-1] + ["gh.ping"])
# ---------- end python_5 ----------
file_2 = ReadFile(File=python_5.path, PerLineParse=True)
python_6 = PythonScript(id=file_2)  # -> out
# ---------- python_6: Python ----------
import pickle
import rhinoscriptsyntax as rs

localFolder = "\\".join(ghenv.Component.OnPingDocument().FilePath.split("\\")[:-1]) + "\\"

with open(localFolder + "meta.file", 'rb') as f:
    meta = pickle.load(f)

jobID = meta['jobID']
#    designID = meta['designID']

imageFolder = localFolder + str(jobID) + "\\images\\"
imageName = imageFolder + str(id) + ".png"
rs.Command("_-ViewCaptureToFile \n\"" + imageName + "\"\n _Enter")

outputFile = localFolder + "python.ping"
with open(outputFile, 'w') as f:
    f.write('ack')

print "complete"
# ---------- end python_6 ----------
